# Grasshopper definition CRSD_6_Grasshopper File.gh (Grasshopper 1.0.8)
# plug-ins: Pufferfish, Bifocals

curvature_threshold = Slider(244, range=0..500)
angle_threshold = Slider(47, range=0..90)
nozzle_height_threshold = Slider(15, range=0..100)
contour_distance = Slider(10, range=0..100)

x_contour_x_tolerance = Slider(10, range=0..10)
x_contour_y_tolerance = Slider(10.497, range=0..12)

y_contour_y_tolerance = Slider(10, range=0..10)
y_contour_x_tolerance = Slider(19.76, range=0..20)

rebuild_curve_count = Slider(100, range=0..100)
box_size = Slider(60, range=0..100)
mesh = Mesh(<mesh referenced from the Rhino model>)
bounding_box = BoundingBox(Content=mesh, Plane=PlaneXY(0, 0, 0))  # -> Box, Box_2
volume = Volume(Geometry=bounding_box.Box_2)  # -> Volume, Centroid
xy_plane = XYPlane(Origin=volume.Centroid)
scale_nu = ScaleNU(Geometry=bounding_box.Box, Plane=xy_plane, ScaleX=Slider(0.9, range=0..1), ScaleY=Slider(0.9, range=0..1), ScaleZ=1)  # -> Geometry, Transform
mesh_split = MeshSplit(Mesh=mesh, Splitters=scale_nu.Geometry)
list_item = ListItem(List=mesh_split, Index=Slider(1, range=0..2), Wrap=True)
mesh_2 = Mesh(list_item)
data = Data(mesh_2)
unit_y = UnitY(Factor=1)
data_2 = Data(box_size)
contour = Contour(Shape=mesh_2, Point=Point(0, 0, 0), Direction=unit_y, Distance=contour_distance)  # -> flatten(Contours)
unit_x = UnitX(Factor=1)
rebuild_curve = RebuildCurve(Curve=contour, Count=rebuild_curve_count, EndTangents=False)
data_3 = Data(mesh_2)
construct_domain = ConstructDomain(DomainStart="0", DomainEnd="1")
divide_curve = DivideCurve(Curve=rebuild_curve, Count=rebuild_curve_count, Kinks=False)  # -> Points, Tangents, Parameters
subtraction = Subtraction(A=rebuild_curve_count, B="1")
data_4 = Data(box_size)
contour_2 = Contour(Shape=mesh_2, Point=Point(0, 0, 0), Direction=unit_x, Distance=contour_distance)  # -> flatten(Contours)
interpolate = Interpolate(Vertices=divide_curve.Points, Degree=3, Periodic=False, KnotStyle=1)  # -> Curve, Length, Domain
range = Range(Domain=construct_domain, Steps=subtraction)
curvature = Curvature(Curve=reparameterize(interpolate.Curve), Parameter=range)  # -> Point, Curvature, Curvature_2
rebuild_curve_2 = RebuildCurve(Curve=contour_2, Count=rebuild_curve_count, EndTangents=False)
length = Length(Curve=curvature.Curvature_2)
construct_domain_2 = ConstructDomain(DomainStart="0", DomainEnd="1")
data_5 = Data(curvature_threshold)
smaller_than = SmallerThan(FirstNumber=length, SecondNumber=data_5)  # -> SmallerThan, OrEqualTo
divide_curve_2 = DivideCurve(Curve=rebuild_curve_2, Count=rebuild_curve_count, Kinks=False)  # -> Points, Tangents, Parameters
subtraction_2 = Subtraction(A=rebuild_curve_count, B="1")
divide_curve_3 = DivideCurve(Curve=interpolate.Curve, Count=rebuild_curve_count, Kinks=False)  # -> Points, Tangents, Parameters
cull_pattern = CullPattern(List=divide_curve_3.Points, CullPattern=smaller_than.SmallerThan)
interpolate_2 = Interpolate(Vertices=divide_curve_2.Points, Degree=3, Periodic=False, KnotStyle=1)  # -> Curve, Length, Domain
range_2 = Range(Domain=construct_domain_2, Steps=subtraction_2)
point = Point(cull_pattern)
polyline = PolyLine(Vertices=point, Closed=False)
curvature_2 = Curvature(Curve=reparameterize(interpolate_2.Curve), Parameter=range_2)  # -> Point, Curvature, Curvature_2
explode = Explode(Curve=polyline, Recursive=True)  # -> Segments, Vertices
end_points = EndPoints(Curve=explode.Segments)  # -> Start, End
data_6 = Data(x_contour_x_tolerance)
data_7 = Data(x_contour_y_tolerance)
divide_curve_4 = DivideCurve(Curve=interpolate_2.Curve, Count=rebuild_curve_count, Kinks=False)  # -> Points, Tangents, Parameters
length_2 = Length(Curve=curvature_2.Curvature_2)
vector_2pt = Vector2Pt(PointA=end_points.Start, PointB=end_points.End, Unitize=False)  # -> Vector, Length
unit_z = UnitZ(Factor=1)
absolute = Absolute(Value=vector_2pt.Vector)
data_8 = Data(box_size)
data_9 = Data(curvature_threshold)
angle = Angle(VectorA=absolute, VectorB=unit_z)  # -> Angle, Reflex
smaller_than_2 = SmallerThan(FirstNumber=length_2, SecondNumber=data_9)  # -> SmallerThan, OrEqualTo
degrees = Degrees(Radians=angle.Angle)
data_10 = Data(angle_threshold)
smaller_than_3 = SmallerThan(FirstNumber=degrees, SecondNumber=data_10)  # -> SmallerThan, OrEqualTo
cull_pattern_2 = CullPattern(List=explode.Segments, CullPattern=smaller_than_3.SmallerThan)
cull_pattern_3 = CullPattern(List=divide_curve_4.Points, CullPattern=smaller_than_2.SmallerThan)
curve = Curve(cull_pattern_2)
end_points_2 = EndPoints(Curve=curve)  # -> graft(Start), graft(End)
data_11 = Data(y_contour_y_tolerance)
point_2 = Point(cull_pattern_3)
data_12 = Data(y_contour_x_tolerance)
deconstruct = Deconstruct(Point=end_points_2.Start)  # -> XComponent, YComponent, ZComponent
deconstruct_2 = Deconstruct(Point=end_points_2.End)  # -> XComponent, YComponent, ZComponent
absolute_2 = Absolute(Value=deconstruct.ZComponent)
absolute_3 = Absolute(Value=deconstruct_2.ZComponent)
highest_lowest_numbers = HighestLowestNumbers(Numbers=flatten([absolute_2, absolute_3]))  # -> Highest, Lowest
data_13 = Data(box_size)
polyline_2 = PolyLine(Vertices=point_2, Closed=Toggle(False))
subtraction_3 = Subtraction(A=highest_lowest_numbers.Highest, B=highest_lowest_numbers.Lowest)
data_14 = Data(nozzle_height_threshold)
larger_than = LargerThan(FirstNumber=subtraction_3, SecondNumber=data_14)  # -> flatten(LargerThan), OrEqualTo
explode_2 = Explode(Curve=polyline_2, Recursive=True)  # -> Segments, Vertices
cull_pattern_4 = CullPattern(List=curve, CullPattern=larger_than.LargerThan)
end_points_3 = EndPoints(Curve=explode_2.Segments)  # -> Start, End
line = Line(flatten(cull_pattern_4))
data_15 = Data(line)
curve_middle = CurveMiddle(Curve=data_15)
deconstruct_3 = Deconstruct(Point=curve_middle)  # -> XComponent, YComponent, ZComponent
sort_list = SortList(Keys=flatten(deconstruct_3.ZComponent), ValuesValuesA=flatten(data_15))  # -> Keys, ValuesValuesA
line_2 = Line(sort_list.ValuesValuesA)
curve_middle_2 = CurveMiddle(Curve=line_2)
deconstruct_4 = Deconstruct(Point=curve_middle_2)  # -> XComponent, YComponent, ZComponent
sort_list_2 = SortList(Keys=deconstruct_4.XComponent, ValuesValuesA=curve_middle_2)  # -> Keys, ValuesValuesA
deconstruct_5 = Deconstruct(Point=sort_list_2.ValuesValuesA)  # -> XComponent, YComponent, ZComponent
shift_list = ShiftList(List=deconstruct_5.XComponent, Shift="1", Wrap=True)
subtraction_4 = Subtraction(A=shift_list, B=deconstruct_5.XComponent)
reverse_list = ReverseList(List=subtraction_4)
larger_than_2 = LargerThan(FirstNumber=reverse_list, SecondNumber=data_6)  # -> LargerThan, OrEqualTo
integer = Integer(larger_than_2.LargerThan)
mass_addition = MassAddition(Input=integer)  # -> Result, PartialResults
create_set = CreateSet(List=mass_addition.PartialResults)  # -> Set, Map
member_index = MemberIndex(Set=mass_addition.PartialResults, Member=create_set.Set)  # -> Index, Count
list_length = ListLength(List=member_index.Index)
reverse_list_2 = ReverseList(List=sort_list_2.ValuesValuesA)
reverse_list_3 = ReverseList(List=list_length)
partition_list = PartitionList(List=reverse_list_2, Size=flatten(reverse_list_3))
deconstruct_6 = Deconstruct(Point=partition_list)  # -> XComponent, YComponent, ZComponent
sort_list_3 = SortList(Keys=deconstruct_6.YComponent, ValuesValuesA=partition_list)  # -> Keys, ValuesValuesA
deconstruct_7 = Deconstruct(Point=sort_list_3.ValuesValuesA)  # -> XComponent, YComponent, ZComponent
shift_list_2 = ShiftList(List=deconstruct_7.YComponent, Shift="1", Wrap=True)
subtraction_5 = Subtraction(A=shift_list_2, B=deconstruct_7.YComponent)
reverse_list_4 = ReverseList(List=subtraction_5)
larger_than_3 = LargerThan(FirstNumber=reverse_list_4, SecondNumber=data_7)  # -> LargerThan, OrEqualTo
integer_2 = Integer(larger_than_3.LargerThan)
mass_addition_2 = MassAddition(Input=integer_2)  # -> Result, PartialResults
create_set_2 = CreateSet(List=mass_addition_2.PartialResults)  # -> Set, Map
member_index_2 = MemberIndex(Set=mass_addition_2.PartialResults, Member=create_set_2.Set)  # -> Index, Count
list_length_2 = ListLength(List=member_index_2.Index)
reverse_list_5 = ReverseList(List=sort_list_3.ValuesValuesA)
reverse_list_6 = ReverseList(List=list_length_2)
partition_list_2 = PartitionList(List=reverse_list_5, Size=flatten(reverse_list_6))  # -> simplify(Chunks)
average = Average(Input=partition_list_2)
center_box = CenterBox(Base=average, X=data_2, Y=data_2, Z=data_2)  # -> flatten(Box)
volume_2 = Volume(Geometry=center_box)  # -> Volume, Centroid
deconstruct_8 = Deconstruct(Point=volume_2.Centroid)  # -> XComponent, YComponent, ZComponent
sort_list_4 = SortList(Keys=deconstruct_8.XComponent, ValuesValuesA=volume_2.Centroid)  # -> Keys, ValuesValuesA
polyline_3 = PolyLine(Vertices=sort_list_4.ValuesValuesA, Closed=False)
deconstruct_9 = Deconstruct(Point=sort_list_4.ValuesValuesA)  # -> XComponent, YComponent, ZComponent
shift_list_3 = ShiftList(List=polyline_3, Shift="1", Wrap=True)
subtraction_6 = Subtraction(A=shift_list_3, B=deconstruct_9.XComponent)
smaller_than_4 = SmallerThan(FirstNumber=subtraction_6, SecondNumber=Slider(1475, range=1400..1700))  # -> SmallerThan, OrEqualTo
dispatch = Dispatch(List=flatten(center_box), DispatchPattern=smaller_than_4.SmallerThan)  # -> ListA, ListB
volume_3 = Volume(Geometry=dispatch.ListB)  # -> Volume, Centroid
polyline_4 = PolyLine(Vertices=volume_3.Centroid, Closed=False)
curve_middle_3 = CurveMiddle(Curve=polyline_4)
center_box_2 = CenterBox(Base=dispatch.ListA, X=data_8, Y=data_8, Z=data_8)
center_box_3 = CenterBox(Base=curve_middle_3, X=data_8, Y=data_8, Z=data_8)
merge = Merge(Data1=center_box_2, Data2=center_box_3)
mesh_split_2 = MeshSplit(Mesh=data, Splitters=merge)
cull_index = CullIndex(List=mesh_split_2, Indices="0", Wrap=True)
bounding_box_2 = BoundingBox(Content=cull_index, Plane=PlaneXY(0, 0, 0))  # -> Box, Box_2
volume_4 = Volume(Geometry=bounding_box_2.Box)  # -> Volume, Centroid
scale = Scale(Geometry=bounding_box_2.Box, Center=volume_4.Centroid, Factor=Slider(0.9, range=0..1))  # -> Geometry, Transform
mesh_3 = Mesh(scale.Geometry)
mesh_split_3 = MeshSplit(Mesh=cull_index, Splitters=mesh_3)
mesh_split_4 = MeshSplit(Mesh=mesh_3, Splitters=cull_index)
area = Area(Geometry=mesh_split_4)  # -> Area, Centroid
smaller_than_5 = SmallerThan(FirstNumber=Slider(1000, range=0..1000), SecondNumber=area.Area)  # -> SmallerThan, OrEqualTo
cull_pattern_5 = CullPattern(List=mesh_split_4, CullPattern=smaller_than_5.SmallerThan)
mesh_4 = Mesh(mesh_split_3)
area_2 = Area(Geometry=mesh_4)  # -> Area, Centroid
area_3 = Area(Geometry=cull_pattern_5)  # -> Area, Centroid
deconstruct_10 = Deconstruct(Point=area_3.Centroid)  # -> XComponent, YComponent, ZComponent
highest_lowest_numbers_2 = HighestLowestNumbers(Numbers=deconstruct_10.ZComponent)  # -> Highest, Lowest
highest_lowest_numbers_3 = HighestLowestNumbers(Numbers=area_2.Area)  # -> Highest, Lowest
equality = Equality(FirstNumber=area_2.Area, SecondNumber=highest_lowest_numbers_3.Highest)  # -> Equality, Inequality
equality_2 = Equality(FirstNumber=deconstruct_10.ZComponent, SecondNumber=highest_lowest_numbers_2.Lowest)  # -> Equality, Inequality
cull_pattern_6 = CullPattern(List=cull_pattern_5, CullPattern=equality_2.Equality)
cull_pattern_7 = CullPattern(List=mesh_split_3, CullPattern=equality.Equality)
mesh_5 = Mesh(cull_pattern_6)
merge_2 = Merge(Data1=cull_pattern_7, Data2=mesh_5)
mesh_6 = Mesh(merge_2)
mesh_join = MeshJoin(Meshes=mesh_6)
mesh_7 = Mesh(mesh_join)
vector_2pt_2 = Vector2Pt(PointA=end_points_3.Start, PointB=end_points_3.End, Unitize=False)  # -> Vector, Length
unit_z_2 = UnitZ(Factor=1)
absolute_4 = Absolute(Value=vector_2pt_2.Vector)
angle_2 = Angle(VectorA=absolute_4, VectorB=unit_z_2)  # -> Angle, Reflex
degrees_2 = Degrees(Radians=angle_2.Angle)
data_16 = Data(angle_threshold)
smaller_than_6 = SmallerThan(FirstNumber=degrees_2, SecondNumber=data_16)  # -> SmallerThan, OrEqualTo
cull_pattern_8 = CullPattern(List=explode_2.Segments, CullPattern=smaller_than_6.SmallerThan)
curve_2 = Curve(cull_pattern_8)
end_points_4 = EndPoints(Curve=curve_2)  # -> graft(Start), graft(End)
deconstruct_11 = Deconstruct(Point=end_points_4.End)  # -> XComponent, YComponent, ZComponent
deconstruct_12 = Deconstruct(Point=end_points_4.Start)  # -> XComponent, YComponent, ZComponent
absolute_5 = Absolute(Value=deconstruct_11.ZComponent)
absolute_6 = Absolute(Value=deconstruct_12.ZComponent)
highest_lowest_numbers_4 = HighestLowestNumbers(Numbers=flatten([absolute_6, absolute_5]))  # -> Highest, Lowest
subtraction_7 = Subtraction(A=highest_lowest_numbers_4.Highest, B=highest_lowest_numbers_4.Lowest)
data_17 = Data(nozzle_height_threshold)
larger_than_4 = LargerThan(FirstNumber=subtraction_7, SecondNumber=data_17)  # -> flatten(LargerThan), OrEqualTo
cull_pattern_9 = CullPattern(List=curve_2, CullPattern=larger_than_4.LargerThan)
line_3 = Line(flatten(cull_pattern_9))
data_18 = Data(line_3)
curve_middle_4 = CurveMiddle(Curve=data_18)
deconstruct_13 = Deconstruct(Point=curve_middle_4)  # -> XComponent, YComponent, ZComponent
sort_list_5 = SortList(Keys=flatten(deconstruct_13.ZComponent), ValuesValuesA=flatten(data_18))  # -> Keys, ValuesValuesA
line_4 = Line(sort_list_5.ValuesValuesA)
curve_middle_5 = CurveMiddle(Curve=line_4)
deconstruct_14 = Deconstruct(Point=curve_middle_5)  # -> XComponent, YComponent, ZComponent
sort_list_6 = SortList(Keys=deconstruct_14.YComponent, ValuesValuesA=curve_middle_5)  # -> Keys, ValuesValuesA
deconstruct_15 = Deconstruct(Point=sort_list_6.ValuesValuesA)  # -> XComponent, YComponent, ZComponent
shift_list_4 = ShiftList(List=deconstruct_15.YComponent, Shift="1", Wrap=True)
subtraction_8 = Subtraction(A=shift_list_4, B=deconstruct_15.YComponent)
reverse_list_7 = ReverseList(List=subtraction_8)
larger_than_5 = LargerThan(FirstNumber=reverse_list_7, SecondNumber=data_11)  # -> LargerThan, OrEqualTo
integer_3 = Integer(larger_than_5.LargerThan)
mass_addition_3 = MassAddition(Input=integer_3)  # -> Result, PartialResults
create_set_3 = CreateSet(List=mass_addition_3.PartialResults)  # -> Set, Map
member_index_3 = MemberIndex(Set=mass_addition_3.PartialResults, Member=create_set_3.Set)  # -> Index, Count
list_length_3 = ListLength(List=member_index_3.Index)
reverse_list_8 = ReverseList(List=sort_list_6.ValuesValuesA)
reverse_list_9 = ReverseList(List=list_length_3)
partition_list_3 = PartitionList(List=reverse_list_8, Size=flatten(reverse_list_9))
deconstruct_16 = Deconstruct(Point=partition_list_3)  # -> XComponent, YComponent, ZComponent
sort_list_7 = SortList(Keys=deconstruct_16.XComponent, ValuesValuesA=partition_list_3)  # -> Keys, ValuesValuesA
deconstruct_17 = Deconstruct(Point=sort_list_7.ValuesValuesA)  # -> XComponent, YComponent, ZComponent
shift_list_5 = ShiftList(List=deconstruct_17.XComponent, Shift="1", Wrap=True)
subtraction_9 = Subtraction(A=shift_list_5, B=deconstruct_17.XComponent)
reverse_list_10 = ReverseList(List=subtraction_9)
larger_than_6 = LargerThan(FirstNumber=reverse_list_10, SecondNumber=data_12)  # -> LargerThan, OrEqualTo
integer_4 = Integer(larger_than_6.LargerThan)
mass_addition_4 = MassAddition(Input=integer_4)  # -> Result, PartialResults
create_set_4 = CreateSet(List=mass_addition_4.PartialResults)  # -> Set, Map
member_index_4 = MemberIndex(Set=mass_addition_4.PartialResults, Member=create_set_4.Set)  # -> Index, Count
list_length_4 = ListLength(List=member_index_4.Index)
reverse_list_11 = ReverseList(List=sort_list_7.ValuesValuesA)
reverse_list_12 = ReverseList(List=list_length_4)
partition_list_4 = PartitionList(List=reverse_list_11, Size=flatten(reverse_list_12))
average_2 = Average(Input=partition_list_4)
center_box_4 = CenterBox(Base=average_2, X=data_4, Y=data_4, Z=data_4)  # -> flatten(Box)
volume_5 = Volume(Geometry=center_box_4)  # -> Volume, Centroid
deconstruct_18 = Deconstruct(Point=volume_5.Centroid)  # -> XComponent, YComponent, ZComponent
sort_list_8 = SortList(Keys=deconstruct_18.XComponent, ValuesValuesA=volume_5.Centroid)  # -> Keys, ValuesValuesA
deconstruct_19 = Deconstruct(Point=sort_list_8.ValuesValuesA)  # -> XComponent, YComponent, ZComponent
polyline_5 = PolyLine(Vertices=sort_list_8.ValuesValuesA, Closed=False)
shift_list_6 = ShiftList(List=polyline_5, Shift="1", Wrap=True)
subtraction_10 = Subtraction(A=shift_list_6, B=deconstruct_19.XComponent)
smaller_than_7 = SmallerThan(FirstNumber=subtraction_10, SecondNumber=Slider(1271, range=0..1600))  # -> SmallerThan, OrEqualTo
dispatch_2 = Dispatch(List=flatten(center_box_4), DispatchPattern=smaller_than_7.SmallerThan)  # -> ListA, ListB
volume_6 = Volume(Geometry=dispatch_2.ListB)  # -> Volume, Centroid
center_box_5 = CenterBox(Base=dispatch_2.ListA, X=data_13, Y=data_13, Z=data_13)  # -> flatten(Box)
mesh_split_5 = MeshSplit(Mesh=data_3, Splitters=center_box_5)
cull_index_2 = CullIndex(List=mesh_split_5, Indices="0", Wrap=True)
bounding_box_3 = BoundingBox(Content=cull_index_2, Plane=PlaneXY(0, 0, 0))  # -> Box, Box_2
volume_7 = Volume(Geometry=bounding_box_3.Box)  # -> Volume, Centroid
scale_2 = Scale(Geometry=bounding_box_3.Box, Center=volume_7.Centroid, Factor=Slider(0.9, range=0..1))  # -> Geometry, Transform
mesh_8 = Mesh(scale_2.Geometry)
mesh_split_6 = MeshSplit(Mesh=cull_index_2, Splitters=mesh_8)
mesh_split_7 = MeshSplit(Mesh=mesh_8, Splitters=cull_index_2)
area_4 = Area(Geometry=mesh_split_7)  # -> Area, Centroid
smaller_than_8 = SmallerThan(FirstNumber=Slider(5000, range=0..5000), SecondNumber=area_4.Area)  # -> SmallerThan, OrEqualTo
cull_pattern_10 = CullPattern(List=mesh_split_7, CullPattern=smaller_than_8.SmallerThan)
area_5 = Area(Geometry=cull_pattern_10)  # -> Area, Centroid
mesh_9 = Mesh(mesh_split_6)
area_6 = Area(Geometry=mesh_9)  # -> Area, Centroid
deconstruct_20 = Deconstruct(Point=area_5.Centroid)  # -> XComponent, YComponent, ZComponent
highest_lowest_numbers_5 = HighestLowestNumbers(Numbers=area_6.Area)  # -> Highest, Lowest
highest_lowest_numbers_6 = HighestLowestNumbers(Numbers=deconstruct_20.ZComponent)  # -> Highest, Lowest
equality_3 = Equality(FirstNumber=area_6.Area, SecondNumber=highest_lowest_numbers_5.Highest)  # -> Equality, Inequality
equality_4 = Equality(FirstNumber=deconstruct_20.ZComponent, SecondNumber=highest_lowest_numbers_6.Lowest)  # -> Equality, Inequality
cull_pattern_11 = CullPattern(List=mesh_split_6, CullPattern=equality_3.Equality)
cull_pattern_12 = CullPattern(List=cull_pattern_10, CullPattern=equality_4.Equality)
center_box_6 = CenterBox(Base=volume_6.Centroid, X=data_13, Y=data_13, Z=data_13)
mesh_10 = Mesh(cull_pattern_12)
merge_3 = Merge(Data1=cull_pattern_11, Data2=mesh_10)
mesh_11 = Mesh(merge_3)
mesh_join_2 = MeshJoin(Meshes=mesh_11)
mesh_12 = Mesh(mesh_join_2)
