# Grasshopper definition CRSD_6_Grasshopper.gh (Grasshopper 1.0.8)
# plug-ins: Pufferfish, Bifocals

# ----
# 0. PARAMETER
contour_distance = Slider(10, range=0..100)
# README: This is the script to find the Areas of Interest from your scanned mesh.
# It consists of several numbered parts:
# 
# 0. PARAMETER
# This is where you can change the parameter of this script to get the AOIs. You can change them based on the level of detail you want to achieve. Other than that, this is used to adjust the output because it is always different cases for every mesh.
# 
# 1. EXTERIOR REMOVAL
# On this section you can change:
# List item: based on which faces you want to exclude
# 
# 
# 
# 2. CURVATURE DETECTION
# On this section you can change:
# Contour Distance: higher number, more detailed
# Rebuild Curve Count: higher number, more detailed
# Curvature Threshold: higher number, more detailed
# 
# 3. ANGLE DETECTION
# On this section you can change:
# Angle threshold: based on limitation of extruder (range of motion)
# 
# 4. HEIGHT DETECTION
# On this section you can change:
# Height threshold: based on the limitation of extruder (nozzle height)
# 
# 5. CLUSTERING AOIs
# On this section you can change:
# X Tolerance: based on how close you want the cluster tolerance to be
# Y Tolerance: based on how close you want the cluster tolerance to be
# 
# 6. REMOVE OVERLAPPING AOIs
# On this section you can change:
# Box Size: how big you want the AOIs to test print
# X Overlapping Tolerance: based on how close you want the cluster tolerance to be
# Y Overlapping Tolerance: based on how close you want the cluster tolerance to be
# 
# 7. MESH AOIs OUTPUT
# On this section you can change:
# X_False Mesh Removal Index: select the mesh unwanted
# X_False Mesh Removal Tolerance: Trial and Error, find the AOIs with closed mesh
# Y_False Mesh Removal Index: select the mesh unwanted
# Y_False Mesh Removal Tolerance: Trial and Error, find the AOIs with closed mesh
rebuild_curve_count = Slider(100, range=0..100)
curvature_threshold = Slider(244, range=0..500)
angle_threshold = Slider(47, range=0..90)
nozzle_height_threshold = Slider(15, range=0..100)
box_size = Slider(30, range=0..100)
x_overlapping_tolerance = Slider(1475, range=1400..1700)
y_overlapping_tolerance = Slider(1271, range=1000..1700)
x_false_mesh_removal_index = Slider(0, range=0..9)
x_false_mesh_removal_tolerance = Slider(1000, range=0..1000)
y_false_mesh_removal_index = Slider(2, range=0..9)
y_false_mesh_removal_tolerance = Slider(730, range=0..5000)

x_contour_x_tolerance = Slider(10, range=0..10)
x_contour_y_tolerance = Slider(10.497, range=0..12)

y_contour_y_tolerance = Slider(10, range=0..10)
y_contour_x_tolerance = Slider(19.76, range=0..20)

# ----
# INPUT
mesh = Mesh(<mesh referenced from the Rhino model>)

# ----
# 1. Exterior Removal
bbox = BoundingBox(Content=mesh, Plane=PlaneXY(0, 0, 0))  # -> Box, Box_2
volume = Volume(Geometry=bbox.Box_2)  # -> Volume, Centroid
xy = XYPlane(Origin=volume.Centroid)
# README
number_slider = Slider(1, range=0..2)
scale_nu = ScaleNU(Geometry=bbox.Box, Plane=xy, ScaleX=Slider(0.9, range=0..1), ScaleY=Slider(0.9, range=0..1), ScaleZ=1)  # -> Geometry, Transform
msplit = MeshSplit(Mesh=mesh, Splitters=scale_nu.Geometry)
item = ListItem(List=msplit, Index=number_slider, Wrap=True)
mesh_2 = Mesh(item)

# ----
# 2. Curvature Detection
Y = UnitY(Factor=1)
contour = Contour(Shape=mesh_2, Point=Point(0, 0, 0), Direction=Y, Distance=contour_distance)  # -> flatten(Contours)
rebcrv = RebuildCurve(Curve=contour, Count=rebuild_curve_count, EndTangents=False)
divide = DivideCurve(Curve=rebcrv, Count=rebuild_curve_count, Kinks=False)  # -> Points, Tangents, Parameters
subtraction = Subtraction(A=rebuild_curve_count, B="1")
dom = ConstructDomain(DomainStart="0", DomainEnd="1")
intcrv = Interpolate(Vertices=divide.Points, Degree=3, Periodic=False, KnotStyle=1)  # -> Curve, Length, Domain
range = Range(Domain=dom, Steps=subtraction)
curvature = Curvature(Curve=reparameterize(intcrv.Curve), Parameter=range)  # -> P, K, C
len = Length(Curve=curvature.C)
data = Data(curvature_threshold)
smaller = SmallerThan(FirstNumber=len, SecondNumber=data)  # -> SmallerThan, OrEqualTo
divide_2 = DivideCurve(Curve=intcrv.Curve, Count=rebuild_curve_count, Kinks=False)  # -> Points, Tangents, Parameters
cull = CullPattern(List=divide_2.Points, CullPattern=smaller.SmallerThan)
pt = Point(cull)

# ----
# Y AXIS
X = UnitX(Factor=1)

# ----
# 2. Curvature Detection
contour_2 = Contour(Shape=mesh_2, Point=Point(0, 0, 0), Direction=X, Distance=contour_distance)  # -> flatten(Contours)
rebcrv_2 = RebuildCurve(Curve=contour_2, Count=rebuild_curve_count, EndTangents=False)
divide_3 = DivideCurve(Curve=rebcrv_2, Count=rebuild_curve_count, Kinks=False)  # -> Points, Tangents, Parameters
subtraction_2 = Subtraction(A=rebuild_curve_count, B="1")
dom_2 = ConstructDomain(DomainStart="0", DomainEnd="1")
intcrv_2 = Interpolate(Vertices=divide_3.Points, Degree=3, Periodic=False, KnotStyle=1)  # -> Curve, Length, Domain
range_2 = Range(Domain=dom_2, Steps=subtraction_2)
curvature_2 = Curvature(Curve=reparameterize(intcrv_2.Curve), Parameter=range_2)  # -> P, K, C
len_2 = Length(Curve=curvature_2.C)
data_2 = Data(curvature_threshold)
smaller_2 = SmallerThan(FirstNumber=len_2, SecondNumber=data_2)  # -> SmallerThan, OrEqualTo
divide_4 = DivideCurve(Curve=intcrv_2.Curve, Count=rebuild_curve_count, Kinks=False)  # -> Points, Tangents, Parameters
cull_2 = CullPattern(List=divide_4.Points, CullPattern=smaller_2.SmallerThan)
pt_2 = Point(cull_2)

# ----
# 3. Angle Detection
pline = PolyLine(Vertices=pt, Closed=False)
explode = Explode(Curve=pline, Recursive=True)  # -> Segments, Vertices
end = EndPoints(Curve=explode.Segments)  # -> Start, End
vec2pt = Vector2Pt(PointA=end.Start, PointB=end.End, Unitize=False)  # -> Vector, Length
abs = Absolute(Value=vec2pt.Vector)
Z = UnitZ(Factor=1)
angle = Angle(VectorA=abs, VectorB=Z)  # -> Angle, Reflex
deg = Degrees(Radians=angle.Angle)
data_3 = Data(angle_threshold)
smaller_3 = SmallerThan(FirstNumber=deg, SecondNumber=data_3)  # -> SmallerThan, OrEqualTo
cull_3 = CullPattern(List=explode.Segments, CullPattern=smaller_3.SmallerThan)
crv = Curve(cull_3)

# ----
# 3. Angle Detection
pline_2 = PolyLine(Vertices=pt_2, Closed=False)
explode_2 = Explode(Curve=pline_2, Recursive=True)  # -> Segments, Vertices
end_2 = EndPoints(Curve=explode_2.Segments)  # -> Start, End
vec2pt_2 = Vector2Pt(PointA=end_2.Start, PointB=end_2.End, Unitize=False)  # -> Vector, Length
abs_2 = Absolute(Value=vec2pt_2.Vector)
Z_2 = UnitZ(Factor=1)
angle_2 = Angle(VectorA=abs_2, VectorB=Z_2)  # -> Angle, Reflex
deg_2 = Degrees(Radians=angle_2.Angle)
data_4 = Data(angle_threshold)
smaller_4 = SmallerThan(FirstNumber=deg_2, SecondNumber=data_4)  # -> SmallerThan, OrEqualTo
cull_4 = CullPattern(List=explode_2.Segments, CullPattern=smaller_4.SmallerThan)
crv_2 = Curve(cull_4)

# ----
# 4. Height Detection
end_3 = EndPoints(Curve=crv)  # -> graft(Start), graft(End)
pdecon = Deconstruct(Point=end_3.Start)  # -> XComponent, YComponent, ZComponent
pdecon_2 = Deconstruct(Point=end_3.End)  # -> XComponent, YComponent, ZComponent
abs_3 = Absolute(Value=pdecon.ZComponent)
abs_4 = Absolute(Value=pdecon_2.ZComponent)
hilonums = HighestLowestNumbers(Numbers=flatten([abs_3, abs_4]))  # -> Highest, Lowest
subtraction_3 = Subtraction(A=hilonums.Highest, B=hilonums.Lowest)
data_5 = Data(nozzle_height_threshold)
larger = LargerThan(FirstNumber=subtraction_3, SecondNumber=data_5)  # -> flatten(LargerThan), OrEqualTo
cull_5 = CullPattern(List=crv, CullPattern=larger.LargerThan)
line = Line(flatten(cull_5))

# ----
# 5. Clustering Areas of Interest
data_6 = Data(line)
midpt = CurveMiddle(Curve=data_6)
pdecon_3 = Deconstruct(Point=midpt)  # -> XComponent, YComponent, ZComponent
sort = SortList(Keys=flatten(pdecon_3.ZComponent), ValuesA=flatten(data_6))  # -> Keys, ValuesA
line_2 = Line(sort.ValuesA)
midpt_2 = CurveMiddle(Curve=line_2)
pdecon_4 = Deconstruct(Point=midpt_2)  # -> XComponent, YComponent, ZComponent
sort_2 = SortList(Keys=pdecon_4.XComponent, ValuesA=midpt_2)  # -> Keys, ValuesA
pdecon_5 = Deconstruct(Point=sort_2.ValuesA)  # -> XComponent, YComponent, ZComponent
shift = ShiftList(List=pdecon_5.XComponent, Shift="1", Wrap=True)
subtraction_4 = Subtraction(A=shift, B=pdecon_5.XComponent)
rev = ReverseList(List=subtraction_4)
data_7 = Data(x_contour_y_tolerance)
data_8 = Data(x_contour_x_tolerance)
larger_2 = LargerThan(FirstNumber=rev, SecondNumber=data_8)  # -> LargerThan, OrEqualTo
int = Integer(larger_2.LargerThan)
ma = MassAddition(Input=int)  # -> Result, PartialResults
cset = CreateSet(List=ma.PartialResults)  # -> Set, Map
mindex = MemberIndex(Set=ma.PartialResults, Member=cset.Set)  # -> Index, Count
lng = ListLength(List=mindex.Index)
rev_2 = ReverseList(List=sort_2.ValuesA)
rev_3 = ReverseList(List=lng)
partition = PartitionList(List=rev_2, Size=flatten(rev_3))
pdecon_6 = Deconstruct(Point=partition)  # -> XComponent, YComponent, ZComponent
sort_3 = SortList(Keys=pdecon_6.YComponent, ValuesA=partition)  # -> Keys, ValuesA
pdecon_7 = Deconstruct(Point=sort_3.ValuesA)  # -> XComponent, YComponent, ZComponent
shift_2 = ShiftList(List=pdecon_7.YComponent, Shift="1", Wrap=True)
subtraction_5 = Subtraction(A=shift_2, B=pdecon_7.YComponent)
rev_4 = ReverseList(List=subtraction_5)
larger_3 = LargerThan(FirstNumber=rev_4, SecondNumber=data_7)  # -> LargerThan, OrEqualTo
int_2 = Integer(larger_3.LargerThan)
ma_2 = MassAddition(Input=int_2)  # -> Result, PartialResults
cset_2 = CreateSet(List=ma_2.PartialResults)  # -> Set, Map
mindex_2 = MemberIndex(Set=ma_2.PartialResults, Member=cset_2.Set)  # -> Index, Count
lng_2 = ListLength(List=mindex_2.Index)
rev_5 = ReverseList(List=sort_3.ValuesA)
rev_6 = ReverseList(List=lng_2)
# X AXIS
partition_2 = PartitionList(List=rev_5, Size=flatten(rev_6))  # -> simplify(Chunks)

# ----
# 6. Removing Overlapping Areas of Interest
avr = Average(Input=partition_2)
data_9 = Data(box_size)
box = CenterBox(Base=avr, X=data_9, Y=data_9, Z=data_9)  # -> flatten(Box)
volume_2 = Volume(Geometry=box)  # -> Volume, Centroid
pdecon_8 = Deconstruct(Point=volume_2.Centroid)  # -> XComponent, YComponent, ZComponent
sort_4 = SortList(Keys=pdecon_8.XComponent, ValuesA=volume_2.Centroid)  # -> Keys, ValuesA
pdecon_9 = Deconstruct(Point=sort_4.ValuesA)  # -> XComponent, YComponent, ZComponent
pline_3 = PolyLine(Vertices=sort_4.ValuesA, Closed=False)
shift_3 = ShiftList(List=pline_3, Shift="1", Wrap=True)
subtraction_6 = Subtraction(A=shift_3, B=pdecon_9.XComponent)
smaller_5 = SmallerThan(FirstNumber=subtraction_6, SecondNumber=x_overlapping_tolerance)  # -> SmallerThan, OrEqualTo
dispatch = Dispatch(List=flatten(box), DispatchPattern=smaller_5.SmallerThan)  # -> ListA, ListB
volume_3 = Volume(Geometry=dispatch.ListB)  # -> Volume, Centroid
pline_4 = PolyLine(Vertices=volume_3.Centroid, Closed=False)
midpt_3 = CurveMiddle(Curve=pline_4)
data_10 = Data(box_size)
box_2 = CenterBox(Base=dispatch.ListA, X=data_10, Y=data_10, Z=data_10)
box_3 = CenterBox(Base=volume_3.Centroid, X=data_10, Y=data_10, Z=data_10)
merge = Merge(Data1=box_2, Data2=box_3)

# ----
# 7. Mesh Output from Areas of Interest
data_11 = Data(mesh_2)
msplit_2 = MeshSplit(Mesh=data_11, Splitters=merge)
cull_i = CullIndex(List=msplit_2, Indices=x_false_mesh_removal_index, Wrap=True)
bbox_2 = BoundingBox(Content=cull_i, Plane=PlaneXY(0, 0, 0))  # -> Box, Box_2
volume_4 = Volume(Geometry=bbox_2.Box)  # -> Volume, Centroid
scale = Scale(Geometry=bbox_2.Box, Center=volume_4.Centroid, Factor=Slider(0.9, range=0..1))  # -> Geometry, Transform
mesh_3 = Mesh(scale.Geometry)
msplit_3 = MeshSplit(Mesh=cull_i, Splitters=mesh_3)
msplit_4 = MeshSplit(Mesh=mesh_3, Splitters=cull_i)
area = Area(Geometry=msplit_4)  # -> Area, Centroid
smaller_6 = SmallerThan(FirstNumber=x_false_mesh_removal_tolerance, SecondNumber=area.Area)  # -> SmallerThan, OrEqualTo
cull_6 = CullPattern(List=msplit_4, CullPattern=smaller_6.SmallerThan)
mesh_4 = Mesh(msplit_3)
area_2 = Area(Geometry=mesh_4)  # -> Area, Centroid
area_3 = Area(Geometry=cull_6)  # -> Area, Centroid
pdecon_10 = Deconstruct(Point=area_3.Centroid)  # -> XComponent, YComponent, ZComponent
hilonums_2 = HighestLowestNumbers(Numbers=pdecon_10.ZComponent)  # -> Highest, Lowest
hilonums_3 = HighestLowestNumbers(Numbers=area_2.Area)  # -> Highest, Lowest
equals = Equality(FirstNumber=area_2.Area, SecondNumber=hilonums_3.Highest)  # -> Equality, Inequality
equals_2 = Equality(FirstNumber=pdecon_10.ZComponent, SecondNumber=hilonums_2.Lowest)  # -> Equality, Inequality
cull_7 = CullPattern(List=cull_6, CullPattern=equals_2.Equality)
cull_8 = CullPattern(List=msplit_3, CullPattern=equals.Equality)
mesh_5 = Mesh(cull_7)
merge_2 = Merge(Data1=cull_8, Data2=mesh_5)
mesh_6 = Mesh(merge_2)
mjoin = MeshJoin(Meshes=mesh_6)

# ----
# 4. Height Detection
end_4 = EndPoints(Curve=crv_2)  # -> graft(Start), graft(End)
pdecon_11 = Deconstruct(Point=end_4.Start)  # -> XComponent, YComponent, ZComponent
pdecon_12 = Deconstruct(Point=end_4.End)  # -> XComponent, YComponent, ZComponent
abs_5 = Absolute(Value=pdecon_11.ZComponent)
abs_6 = Absolute(Value=pdecon_12.ZComponent)
hilonums_4 = HighestLowestNumbers(Numbers=flatten([abs_5, abs_6]))  # -> Highest, Lowest
subtraction_7 = Subtraction(A=hilonums_4.Highest, B=hilonums_4.Lowest)
data_12 = Data(nozzle_height_threshold)
larger_4 = LargerThan(FirstNumber=subtraction_7, SecondNumber=data_12)  # -> flatten(LargerThan), OrEqualTo
cull_9 = CullPattern(List=crv_2, CullPattern=larger_4.LargerThan)
line_3 = Line(flatten(cull_9))

# ----
# 5. Clustering Areas of Interest
data_13 = Data(line_3)
midpt_4 = CurveMiddle(Curve=data_13)
pdecon_13 = Deconstruct(Point=midpt_4)  # -> XComponent, YComponent, ZComponent
sort_5 = SortList(Keys=flatten(pdecon_13.ZComponent), ValuesA=flatten(data_13))  # -> Keys, ValuesA
line_4 = Line(sort_5.ValuesA)
midpt_5 = CurveMiddle(Curve=line_4)
pdecon_14 = Deconstruct(Point=midpt_5)  # -> XComponent, YComponent, ZComponent
sort_6 = SortList(Keys=pdecon_14.YComponent, ValuesA=midpt_5)  # -> Keys, ValuesA
pdecon_15 = Deconstruct(Point=sort_6.ValuesA)  # -> XComponent, YComponent, ZComponent
shift_4 = ShiftList(List=pdecon_15.YComponent, Shift="1", Wrap=True)
subtraction_8 = Subtraction(A=shift_4, B=pdecon_15.YComponent)
rev_7 = ReverseList(List=subtraction_8)
data_14 = Data(y_contour_x_tolerance)
data_15 = Data(y_contour_y_tolerance)
larger_5 = LargerThan(FirstNumber=rev_7, SecondNumber=data_15)  # -> LargerThan, OrEqualTo
int_3 = Integer(larger_5.LargerThan)
ma_3 = MassAddition(Input=int_3)  # -> Result, PartialResults
cset_3 = CreateSet(List=ma_3.PartialResults)  # -> Set, Map
mindex_3 = MemberIndex(Set=ma_3.PartialResults, Member=cset_3.Set)  # -> Index, Count
lng_3 = ListLength(List=mindex_3.Index)
rev_8 = ReverseList(List=sort_6.ValuesA)
rev_9 = ReverseList(List=lng_3)
partition_3 = PartitionList(List=rev_8, Size=flatten(rev_9))
pdecon_16 = Deconstruct(Point=partition_3)  # -> XComponent, YComponent, ZComponent
sort_7 = SortList(Keys=pdecon_16.XComponent, ValuesA=partition_3)  # -> Keys, ValuesA
pdecon_17 = Deconstruct(Point=sort_7.ValuesA)  # -> XComponent, YComponent, ZComponent
shift_5 = ShiftList(List=pdecon_17.XComponent, Shift="1", Wrap=True)
subtraction_9 = Subtraction(A=shift_5, B=pdecon_17.XComponent)
rev_10 = ReverseList(List=subtraction_9)
larger_6 = LargerThan(FirstNumber=rev_10, SecondNumber=data_14)  # -> LargerThan, OrEqualTo
int_4 = Integer(larger_6.LargerThan)
ma_4 = MassAddition(Input=int_4)  # -> Result, PartialResults
cset_4 = CreateSet(List=ma_4.PartialResults)  # -> Set, Map
mindex_4 = MemberIndex(Set=ma_4.PartialResults, Member=cset_4.Set)  # -> Index, Count
lng_4 = ListLength(List=mindex_4.Index)
rev_11 = ReverseList(List=sort_7.ValuesA)
rev_12 = ReverseList(List=lng_4)
partition_4 = PartitionList(List=rev_11, Size=flatten(rev_12))  # -> simplify(Chunks)

# ----
# 6. Removing Overlapping Areas of Interest
avr_2 = Average(Input=partition_4)
data_16 = Data(box_size)
box_4 = CenterBox(Base=avr_2, X=data_16, Y=data_16, Z=data_16)  # -> flatten(Box)
volume_5 = Volume(Geometry=box_4)  # -> Volume, Centroid
pdecon_18 = Deconstruct(Point=volume_5.Centroid)  # -> XComponent, YComponent, ZComponent
sort_8 = SortList(Keys=pdecon_18.XComponent, ValuesA=volume_5.Centroid)  # -> Keys, ValuesA
pdecon_19 = Deconstruct(Point=sort_8.ValuesA)  # -> XComponent, YComponent, ZComponent
pline_5 = PolyLine(Vertices=sort_8.ValuesA, Closed=False)
shift_6 = ShiftList(List=pline_5, Shift="1", Wrap=True)
subtraction_10 = Subtraction(A=shift_6, B=pdecon_19.XComponent)
smaller_7 = SmallerThan(FirstNumber=subtraction_10, SecondNumber=y_overlapping_tolerance)  # -> SmallerThan, OrEqualTo
dispatch_2 = Dispatch(List=flatten(box_4), DispatchPattern=smaller_7.SmallerThan)  # -> ListA, ListB
volume_6 = Volume(Geometry=dispatch_2.ListB)  # -> Volume, Centroid
pline_6 = PolyLine(Vertices=volume_6.Centroid, Closed=False)
midpt_6 = CurveMiddle(Curve=pline_6)
data_17 = Data(box_size)
box_5 = CenterBox(Base=dispatch_2.ListA, X=data_17, Y=data_17, Z=data_17)
box_6 = CenterBox(Base=volume_6.Centroid, X=data_17, Y=data_17, Z=data_17)
merge_3 = Merge(Data1=box_5, Data2=box_6)  # -> flatten(Result)

# ----
# 7. Mesh Output from Areas of Interest
data_18 = Data(mesh_2)
msplit_5 = MeshSplit(Mesh=data_18, Splitters=merge_3)
cull_i_2 = CullIndex(List=msplit_5, Indices=y_false_mesh_removal_index, Wrap=True)
bbox_3 = BoundingBox(Content=cull_i_2, Plane=PlaneXY(0, 0, 0))  # -> Box, Box_2
volume_7 = Volume(Geometry=bbox_3.Box)  # -> Volume, Centroid
scale_2 = Scale(Geometry=bbox_3.Box, Center=volume_7.Centroid, Factor=Slider(0.9, range=0..1))  # -> Geometry, Transform
mesh_7 = Mesh(scale_2.Geometry)
msplit_6 = MeshSplit(Mesh=cull_i_2, Splitters=mesh_7)
msplit_7 = MeshSplit(Mesh=mesh_7, Splitters=cull_i_2)
area_4 = Area(Geometry=msplit_7)  # -> Area, Centroid
smaller_8 = SmallerThan(FirstNumber=y_false_mesh_removal_tolerance, SecondNumber=area_4.Area)  # -> SmallerThan, OrEqualTo
cull_10 = CullPattern(List=msplit_7, CullPattern=smaller_8.SmallerThan)
mesh_8 = Mesh(msplit_6)
area_5 = Area(Geometry=mesh_8)  # -> Area, Centroid
area_6 = Area(Geometry=cull_10)  # -> Area, Centroid
pdecon_20 = Deconstruct(Point=area_6.Centroid)  # -> XComponent, YComponent, ZComponent
hilonums_5 = HighestLowestNumbers(Numbers=pdecon_20.ZComponent)  # -> Highest, Lowest
hilonums_6 = HighestLowestNumbers(Numbers=area_5.Area)  # -> Highest, Lowest
equals_3 = Equality(FirstNumber=area_5.Area, SecondNumber=hilonums_6.Highest)  # -> Equality, Inequality
equals_4 = Equality(FirstNumber=pdecon_20.ZComponent, SecondNumber=hilonums_5.Lowest)  # -> Equality, Inequality
cull_11 = CullPattern(List=cull_10, CullPattern=equals_4.Equality)
cull_12 = CullPattern(List=msplit_6, CullPattern=equals_3.Equality)
mesh_9 = Mesh(cull_11)
merge_4 = Merge(Data1=cull_12, Data2=mesh_9)
mesh_10 = Mesh(merge_4)
mjoin_2 = MeshJoin(Meshes=mesh_10)

# ----
# OUTPUT
mesh_11 = Mesh(mjoin)

# ----
# OUTPUT
mesh_12 = Mesh(mjoin_2)
